# Dynamo graph SIGNALI SABIRANJE_script.dyn "SIGNALI SABIRANJE" (Dynamo 2.12.1.8246)
# packages: spring nodes 210.1.1, Data-Shapes 2022.2.103, Rhythm 2022.4.3, Clockwork for Dynamo 2.x 2.4.0, WombatDynamo 2.3.5, Caribou 2.0.3

# group: UI Programa
string = StringInput("PROGRAM ZA SABIRANJE SIGNALA")
file_path = Filename("..\Logo\Termovent logo-02.png")
string_2 = StringInput("SABERI")
string_3 = StringInput("UPUTSTVO")
string_4 = StringInput("Potrebno je da šema na kojoj se sabiraju signali bude aktivan prozor u Revitu")
ui_textnote_data = Custom[UI.TextNote Data](Title=string_3, TextNote=string_4)  # package Data-Shapes; Create Data for TextNote input in UI.MultipleInputForm ++ . Check out www.data-shapes.net for more informations
string_5 = StringInput("Izaberi traku za sabiranje signala na šemi")
string_6 = StringInput("Izaberi")
boolean = BoolSelector(true)
string_7 = StringInput("IZAĐI")
code_block = CodeBlock { 0; }

boolean_2 = BoolSelector(true)
ui_selectmodelelements_data = Custom[UI.SelectModelElements Data](InputName=string_5, ButtonText=string_6, SelectSingleElement=boolean_2)  # package Data-Shapes; Creates a Revit element selection input for UI.MultipleInputForm++ . Check out www.data-shapes.net for more infos!

# group (continued): UI Programa
list_create = List.Create(item0=ui_textnote_data, item1=ui_selectmodelelements_data)
ui_multipleinputform = Custom[UI.MultipleInputForm ++](Description_optional=string, Logo_optional=file_path, ButtonText_optional=string_2, Inputs=list_create, Toggle=boolean, CancelButtonText_optional=string_7)  # package Data-Shapes; Create a form with multiple inputs. see www.data-shapes.net for tutorials and infos!
flatten = List.Flatten(list=ui_multipleinputform.User_Inputs)
getItemAtIndex = List.GetItemAtIndex(list=flatten, index=code_block)

code_block_2 = CodeBlock { 100; }
pause = Thread.Pause(object=getItemAtIndex, msTimeout=code_block_2)
setParameterByName = Element.SetParameterByName(element=pause)  # unwired: parameterName, value
string_8 = StringInput("EMS AI")
string_9 = StringInput("EMS AO")
string_10 = StringInput("EMS DI")
string_11 = StringInput("EMS DO")
string_12 = StringInput("BMS AI")
string_13 = StringInput("BMS AO")
string_14 = StringInput("BMS DI")
string_15 = StringInput("BMS DO")
string_16 = StringInput("Comm AI")
string_17 = StringInput("Comm AO")
string_18 = StringInput("Comm DI")
string_19 = StringInput("Comm DO")
list_create_2 = List.Create(item0=string_8, item1=string_9, item2=string_10, item3=string_11, item4=string_12, item5=string_13, item6=string_14, item7=string_15, item8=string_16, item9=string_17, item10=string_18, item11=string_19)
string_20 = StringInput("Detail Item Tags")

# group: Tagovi iz aktvnog pogleda
boolean_3 = BoolSelector(true)
ꟿ_document_activeview = Custom[ꟿ Document.ActiveView](refresh=boolean_3)  # package spring nodes; Selects the current document's active view. Supports more view types than the built-in option. Will be depreciated once the bult in node works with all plan types.
all_elements_in_view_s = Custom[All Elements In View(s)](Views=ꟿ_document_activeview)  # package Data-Shapes; Retrieves all visible element in a view or a set of views
ꟿ_list_filterbycategoryname = Custom[ꟿ List.FilterByCategoryName](element=all_elements_in_view_s, categoryName=string_20)  # package spring nodes; Filters the input elements by their category name. You can input multiple category names.
watch = Watch(ꟿ_list_filterbycategoryname.in)

# group: GEOMETRIJA TRAKE SIGNALA I TAGOVI KOJI SU LOCIRANI NA NJEMU
getLocation = Element.GetLocation(element=getItemAtIndex)
XAxis = Vector.XAxis()
string_21 = StringInput("Weight")
getParameterValueByName = Element.GetParameterValueByName(element=getItemAtIndex, parameterName=string_21)
byStartPointDirectionLength = Line.ByStartPointDirectionLength(startPoint=getLocation, direction=XAxis, length=getParameterValueByName)
byGeometry = BoundingBox.ByGeometry(geom=byStartPointDirectionLength)
code_block_3 = CodeBlock { 15; }
offset = Curve.Offset(curve=byStartPointDirectionLength, distance=code_block_3)
byGeometry_2 = BoundingBox.ByGeometry(geom=offset)
list_create_3 = List.Create(item0=byGeometry, item1=byGeometry_2)
fromBoundingBoxes = Custom[BoundingBox.FromBoundingBoxes](boundingBoxes=list_create_3)  # package Clockwork for Dynamo 2.x; Merges a list of bounding boxes into a single bounding box
ʳʰʸᵗʰᵐ_tags_getheadposition = Rhythm.Revit.Elements.Tags.GetHeadPosition(tag=watch)
contains = BoundingBox.Contains(boundingBox=fromBoundingBoxes, point=ʳʰʸᵗʰᵐ_tags_getheadposition)
filterByBoolMask = List.FilterByBoolMask(list=watch, mask=contains)
watch_2 = Watch(filterByBoolMask.in)

# group: FILTRIRANJE TAGA PO VRSTI SIGNALA
getType = WombatDynamo.Element.GetType(element=watch_2)
string_from_object = FromObject(obj=getType)
string_22 = StringInput("EMS")
contains_2 = String.Contains(string=string_from_object, searchFor=string_22)
filterByBoolMask_2 = List.FilterByBoolMask(list=watch_2, mask=contains_2)
taggedElement = Tag.TaggedElement(tag=filterByBoolMask_2.in)
string_23 = StringInput("BMS")
contains_3 = String.Contains(string=string_from_object, searchFor=string_23)
filterByBoolMask_3 = List.FilterByBoolMask(list=watch_2, mask=contains_3)
taggedElement_2 = Tag.TaggedElement(tag=filterByBoolMask_3.in)
string_24 = StringInput("Comm")
contains_4 = String.Contains(string=string_from_object, searchFor=string_24)
filterByBoolMask_4 = List.FilterByBoolMask(list=watch_2, mask=contains_4)
taggedElement_3 = Tag.TaggedElement(tag=filterByBoolMask_4.in)

string_25 = StringInput("MC AI")
string_26 = StringInput("MC AO")
string_27 = StringInput("MC DI")
string_28 = StringInput("MC DO")

# group: EMS
getParameterValueByName_2 = Element.GetParameterValueByName(element=taggedElement, parameterName=string_25)
toNumber = String.ToNumber(string=getParameterValueByName_2)
mc_ai = Custom[MC AI](Double=toNumber)  # package Caribou
code_block_4 = CodeBlock { 0; }
number_to_rounded_string = Custom[Number to Rounded String](Number=mc_ai, Decimals=code_block_4)  # package Data-Shapes; Returns rounded number to specified number of decimals as string
getParameterValueByName_3 = Element.GetParameterValueByName(element=taggedElement, parameterName=string_26)
toNumber_2 = String.ToNumber(string=getParameterValueByName_3)
mc_ao = Custom[MC AO](Double=toNumber_2)  # package Caribou
code_block_5 = CodeBlock { 0; }
number_to_rounded_string_2 = Custom[Number to Rounded String](Number=mc_ao, Decimals=code_block_5)
getParameterValueByName_4 = Element.GetParameterValueByName(element=taggedElement, parameterName=string_27)
toNumber_3 = String.ToNumber(string=getParameterValueByName_4)
mc_di = Custom[MC DI](Double=toNumber_3)  # package Caribou
code_block_6 = CodeBlock { 0; }
number_to_rounded_string_3 = Custom[Number to Rounded String](Number=mc_di, Decimals=code_block_6)
getParameterValueByName_5 = Element.GetParameterValueByName(element=taggedElement, parameterName=string_28)
toNumber_4 = String.ToNumber(string=getParameterValueByName_5)
mc_do = Custom[MC DO](Double=toNumber_4)  # package Caribou
code_block_7 = CodeBlock { 0; }
number_to_rounded_string_4 = Custom[Number to Rounded String](Number=mc_do, Decimals=code_block_7)

# group: BMS
getParameterValueByName_6 = Element.GetParameterValueByName(element=taggedElement_2, parameterName=string_25)
toNumber_5 = String.ToNumber(string=getParameterValueByName_6)
mc_ai_2 = Custom[MC AI](Double=toNumber_5)
code_block_8 = CodeBlock { 0; }
number_to_rounded_string_5 = Custom[Number to Rounded String](Number=mc_ai_2, Decimals=code_block_8)
getParameterValueByName_7 = Element.GetParameterValueByName(element=taggedElement_2, parameterName=string_26)
toNumber_6 = String.ToNumber(string=getParameterValueByName_7)
mc_ao_2 = Custom[MC AO](Double=toNumber_6)
code_block_9 = CodeBlock { 0; }
number_to_rounded_string_6 = Custom[Number to Rounded String](Number=mc_ao_2, Decimals=code_block_9)
getParameterValueByName_8 = Element.GetParameterValueByName(element=taggedElement_2, parameterName=string_27)
toNumber_7 = String.ToNumber(string=getParameterValueByName_8)
mc_di_2 = Custom[MC DI](Double=toNumber_7)
code_block_10 = CodeBlock { 0; }
number_to_rounded_string_7 = Custom[Number to Rounded String](Number=mc_di_2, Decimals=code_block_10)
getParameterValueByName_9 = Element.GetParameterValueByName(element=taggedElement_2, parameterName=string_28)
toNumber_8 = String.ToNumber(string=getParameterValueByName_9)
mc_do_2 = Custom[MC DO](Double=toNumber_8)
code_block_11 = CodeBlock { 0; }
number_to_rounded_string_8 = Custom[Number to Rounded String](Number=mc_do_2, Decimals=code_block_11)

# group: COMM
getParameterValueByName_10 = Element.GetParameterValueByName(element=taggedElement_3, parameterName=string_25)
toNumber_9 = String.ToNumber(string=getParameterValueByName_10)
mc_ai_3 = Custom[MC AI](Double=toNumber_9)
code_block_12 = CodeBlock { 0; }
number_to_rounded_string_9 = Custom[Number to Rounded String](Number=mc_ai_3, Decimals=code_block_12)
getParameterValueByName_11 = Element.GetParameterValueByName(element=taggedElement_3, parameterName=string_26)
toNumber_10 = String.ToNumber(string=getParameterValueByName_11)
mc_ao_3 = Custom[MC AO](Double=toNumber_10)
code_block_13 = CodeBlock { 0; }
number_to_rounded_string_10 = Custom[Number to Rounded String](Number=mc_ao_3, Decimals=code_block_13)
getParameterValueByName_12 = Element.GetParameterValueByName(element=taggedElement_3, parameterName=string_27)
toNumber_11 = String.ToNumber(string=getParameterValueByName_12)
mc_di_3 = Custom[MC DI](Double=toNumber_11)
code_block_14 = CodeBlock { 0; }
number_to_rounded_string_11 = Custom[Number to Rounded String](Number=mc_di_3, Decimals=code_block_14)
getParameterValueByName_13 = Element.GetParameterValueByName(element=taggedElement_3, parameterName=string_28)
toNumber_12 = String.ToNumber(string=getParameterValueByName_13)
mc_do_3 = Custom[MC DO](Double=toNumber_12)
code_block_15 = CodeBlock { 0; }
number_to_rounded_string_12 = Custom[Number to Rounded String](Number=mc_do_3, Decimals=code_block_15)

list_create_4 = List.Create(item0=number_to_rounded_string, item1=number_to_rounded_string_2, item2=number_to_rounded_string_3, item3=number_to_rounded_string_4, item4=number_to_rounded_string_5, item5=number_to_rounded_string_6, item6=number_to_rounded_string_7, item7=number_to_rounded_string_8, item8=number_to_rounded_string_9, item9=number_to_rounded_string_10, item10=number_to_rounded_string_11, item11=number_to_rounded_string_12)
empty = List.Empty()
replaceNull = Python(IN[0]=list_create_4, IN[1]=empty)  # "List.ReplaceNull"; IronPython2
# ---------- replaceNull.python (8 lines) ----------
items = IN[0]
rep = IN[1]
elementlist = list()
for item in items:
	if item is None: 
		item = rep
	elementlist.append(item)
OUT = elementlist
# ----------------------------------------
combine = List.Combine(comb=setParameterByName, list1=list_create_2, list2=replaceNull)
categories = Categories()  # nothing selected
